# Grasshopper definition RAK_trees.gh (Grasshopper 1.0.7)
# plug-ins: LunchBox

toggle = BooleanToggle(True)
geo = Geometry([<brep referenced from the Rhino model> x2])
geo_2 = Geometry(<brep referenced from the Rhino model>)
crv = Curve([<curve referenced from the Rhino model> x2])
edges = BrepEdges(Brep=geo)  # -> Naked, Interior, NonManifold
project = Project(Curve=crv, Brep=geo_2, Direction=Vector(0, 0, 1))
join = JoinCurves(Curves=edges.Naked, Preserve=False)
project_2 = Project(Curve=join, Brep=geo_2, Direction=Vector(0, 0, 1))
ccx = CurveCurve(CurveA=project_2, CurveB=flatten(project))  # -> Points, ParamsA, flatten(ParamsB)
shatter = Shatter(Curve=project, Parameters=ccx.ParamsB)
layer_ref = LayerReference(ReferenceToggle=toggle, LayerName="GREENERY")  # -> Geometry, Name, UserStrings, GUID
layer_ref_2 = LayerReference(ReferenceToggle=toggle, LayerName="STREETS")  # -> Geometry, Name, UserStrings, GUID
layer_ref_3 = LayerReference(ReferenceToggle=toggle, LayerName="TOPOGRAPHY")  # -> Geometry, Name, UserStrings, GUID
layer_ref_4 = LayerReference(ReferenceToggle=toggle, LayerName="PARKING")  # -> Geometry, Name, UserStrings, GUID
layer_ref_5 = LayerReference(ReferenceToggle=toggle, LayerName="LA_TREES")  # -> Geometry, Name, UserStrings, GUID
layer_ref_6 = LayerReference(ReferenceToggle=toggle, LayerName="LA_TRACES")  # -> Geometry, Name, UserStrings, GUID
midpt = CurveMiddle(Curve=shatter)
panel = Panel(shatter)
incurves = PointInCurves(Point=flatten(midpt), Curves=flatten(project_2))  # -> Relationship, Index, Point
item = ListItem(List=shatter, Index=0, Wrap=True)
equals = Equality(FirstNumber=incurves.Relationship, SecondNumber=2)  # -> Equality, Inequality
crv_2 = Curve(layer_ref_5.Geometry)
debrep = DeconstructBrep(Brep=layer_ref_4.Geometry)  # -> flatten(Faces), Edges, Vertices
crv_3 = Curve(layer_ref_6.Geometry)
cull = CullPattern(List=shatter, CullPattern=invert(equals.Equality))
cull_2 = CullPattern(List=shatter, CullPattern=equals.Equality)
area = Area(Geometry=crv_2)  # -> Area, Centroid
panel_2 = Panel(equals.Equality)
evalsrf = EvaluateSurface(Surface=debrep.Faces, Point="0,0")  # -> Point, flatten(Normal), UDirection, VDirection, Frame
project_3 = Project(Curve=cull_2, Brep=geo, Direction=Vector(0, 0, 1))
brep = Brep(layer_ref_3.Geometry)
devec = DeconstructVector(Vector=evalsrf.Normal)  # -> XComponent, YComponent, ZComponent
crv_4 = Curve(project_3)
crv_5 = Curve(cull)
abs = Absolute(Value=devec.ZComponent)
equals_2 = Equality(FirstNumber=devec.ZComponent, SecondNumber=1)  # -> Equality, Inequality
panel_3 = Panel(crv_5)
cull_3 = CullPattern(List=debrep.Faces, CullPattern=equals_2.Equality)
brep_2 = Brep([layer_ref_2.Geometry, layer_ref.Geometry, cull_3])
project_4 = Project(Curve=crv_3, Brep=graft(brep_2), Direction=Vector(0, 0, 1))
project_5 = Project(Curve=crv_3, Brep=brep, Direction=Vector(0, 0, 1))
brep_3 = Brep([layer_ref.Geometry, layer_ref_3.Geometry, layer_ref_2.Geometry, cull_3])
Z = UnitZ(Factor=1)
crv_6 = Curve([project_4, project_5])
project_6 = ProjectPoint(Point=area.Centroid, Direction=Z, Geometry=brep_3)  # -> Point, Index
nº_rotaciones = Slider(8, range=0..10)
inclinación_máxima_árboles = Slider(10, range=0..100)
altura_mínima_árboles = Slider(6.5, range=0..10)
relación_copa_tronco = Slider(0.9, range=0..1)
altura_máxima_árboles = Slider(9, range=0..15)
anchura_mínima_árboles = Slider(0.35, range=0..1)
anchura_máxima_árboles = Slider(0.55, range=0..1)

# ---- group: LOCALIZACIÓN ÁRBOLES
pt = Point(project_6.Point)

# ----
lng = ListLength(List=flatten(pt))
dom = ConstructDomain(DomainStart=altura_máxima_árboles, DomainEnd=altura_mínima_árboles)
division = Division(A=inclinación_máxima_árboles, B=lng)
multiplication = Multiplication(A=altura_máxima_árboles, B=relación_copa_tronco)
multiplication_2 = Multiplication(A=altura_mínima_árboles, B=relación_copa_tronco)
range = Range(Domain=dom, Steps=expr("X-1", lng))  # -> graft(Range)
series = Series(Start=0, Step=division, Count=expr("X+1", lng))
cull_i = CullIndex(List=series, Indices=0, Wrap=True)
rad = Radians(Degrees=cull_i)
dom_2 = ConstructDomain(DomainStart=multiplication, DomainEnd=multiplication_2)
dom_3 = ConstructDomain(DomainStart=expr("X*.5", anchura_mínima_árboles), DomainEnd=expr("X*.5", anchura_máxima_árboles))
tan = Tangent(Value=rad)
range_2 = Range(Domain=dom_3, Steps=expr("X-1", lng))
range_3 = Range(Domain=dom_2, Steps=expr("X-1", lng))
multiplication_3 = Multiplication(A=tan, B=range)
pi = Pi(Factor=Slider(2, range=0..10))
dom_4 = ConstructDomain(DomainStart=0, DomainEnd=pi)
range_4 = Range(Domain=dom_4, Steps=nº_rotaciones)
line = LineSDL(Start=pt, Direction=Vector(0, 0, 1), Length=range)
X = UnitX(Factor=1)
cull_i_2 = CullIndex(List=range_4, Indices=0, Wrap=True)  # -> graft(List)
rot3d = Rotate3D(Geometry=line, Angle=graft(rad), Center=pt, Axis=X)  # -> Geometry, Transform
rot3d_2 = Rotate3D(Geometry=rot3d.Geometry, Angle=flatten(cull_i_2), Center=pt, Axis=Vector(0, 0, 1))  # -> Geometry, Transform
lng_2 = ListLength(List=flatten(rot3d_2.Geometry))
dom_5 = ConstructDomain(DomainStart=0, DomainEnd=lng_2)
random = Random(Range=dom_5, Number=lng_2, Seed=2)
unflatten = UnflattenTree(Tree=random, Guide=rot3d_2.Geometry)
item_2 = ListItem(List=unflatten, Index=0, Wrap=True)
item_3 = ListItem(List=rot3d_2.Geometry, Index=item_2, Wrap=True)
rev = ReverseList(List=flatten(item_3))  # -> graft(List)
end = EndPoints(Curve=item_3)  # -> Start, End
pt_2 = Point(end.End)
sph = Sphere(Base=pt_2, Radius=expr("X*.5", graft(range_3)))
pipe = Pipe(Curve=rev, Radius=graft(range_2), Caps=1)
